# Grasshopper definition test01.gh (Grasshopper 1.0.8)
# plug-ins: RhinoCodePluginGH, MeshEdit Components

pt = Point(Tree({0}: [Point(0, 800, 10.75790194), Point(34.72598587, 800, 8.75790194), Point(55, 800, -11.24209806), Point(61.91968224, 800, -37.60116137), Point(56.91968224, 800, -50.4348426), Point(51.34551169, 800, -99.87876893), Point(14.72598587, 800, -116.8787689), Point(0, 800, -116.8787689)], {1}: [Point(0, 881.3343783, 18.25790194), Point(34.72598587, 881.3343783, 18.25790194), Point(82.33763683, 881.3343783, 15.25790194), Point(82.33763683, 881.3343783, -38.60116137), Point(115.2124651, 881.3343783, -48.22949273), Point(97.85521735, 881.3343783, -92.31802166), Point(25.72598587, 881.3343783, -141.8787689), Point(0, 881.3343783, -141.8787689)], {2}: [Point(0, 998.0771873, 18.25790194), Point(34.72598587, 998.0771873, 18.25790194), Point(82.33763683, 998.0771873, 15.25790194), Point(82.33763683, 998.0771873, -38.60116137), Point(115.2124651, 998.0771873, -55.08805662), Point(97.85521735, 998.0771873, -92.31802166), Point(25.72598587, 998.0771873, -141.8787689), Point(0, 998.0771873, -141.8787689)], {3}: [Point(0, 1152.957751, 1.854295127), Point(14.72598587, 1152.957751, 1.854295127), Point(30, 1162.957751, -9.704530279), Point(30, 1162.957751, -20.69167303), Point(27.64558823, 1150.457751, -39.21586264), Point(27.64558823, 1140.457751, -54.34253224), Point(18.72598587, 1130, -69.73790245), Point(0, 1130, -69.73790245)]))
item = ListItem(List=pt, Index=0, Wrap=True)
split = SplitTree(Data=pt, Masks=flatten("{1,2}"))  # -> Positive, Negative
yz = YZPlane(Origin=item)
item_2 = ListItem(List=flatten(yz), Index=0, Wrap=True)
partition = PartitionList(List=split.Positive, Size="2")
bang = ExplodeTree(Data=partition)  # -> Branch0, Branch1, Branch2, Branch3, Branch4, Branch5, Branch6, Branch7
number_slider = Slider(11, range=0..20)
number_slider_2 = Slider(14, range=0..20)
number_slider_3 = Slider(11, range=2..20)
number_slider_4 = Slider(17, range=0..20)
pt_2 = Point(Point(0, 0, 0))
Z = UnitZ(Factor=Slider(837, range=0..1000))
pi = Pi(Factor=1)
swatch = ColourSwatch(SwatchColor=RGB(196, 192, 192))

hullwidth = Slider(-10, range=-10..10)
wingspan = Slider(10, range=-10..10)
wingstart = Slider(0, range=-10..10)
wingend = Slider(0, range=-10..10)

hullwidth_2 = GetNumber(hullwidth, AtLeast=0, AtMost=2, Maximum=1.797693135e+308, Minimum=-1.797693135e+308, TreeAccess=False)
wingspan_2 = GetNumber(wingspan, AtLeast=1, AtMost=2147483647, Maximum=1.797693135e+308, Minimum=-1.797693135e+308, TreeAccess=False)
wingstart_2 = GetNumber(wingstart, AtLeast=1, AtMost=2147483647, Maximum=1.797693135e+308, Minimum=-1.797693135e+308, TreeAccess=False)
wingend_2 = GetNumber(wingend, AtLeast=1, AtMost=2147483647, Maximum=1.797693135e+308, Minimum=-1.797693135e+308, TreeAccess=False)

remap = RemapNumbers(Value=hullwidth_2, Source="-10 to 10", Target="2 to 10")  # -> Mapped, Clipped
remap_2 = RemapNumbers(Value=wingstart_2, Source="-10 to 10", Target="-10 to 15")  # -> Mapped, Clipped
remap_3 = RemapNumbers(Value=wingend_2, Source="-10 to 10", Target="-10 to 15")  # -> Mapped, Clipped
remap_4 = RemapNumbers(Value=wingspan_2, Source="-10 to 10", Target="-5 to 12")  # -> Mapped, Clipped
multiplication = Multiplication(A=remap_4.Mapped, B="5")
multiplication_2 = Multiplication(A=remap.Clipped, B="5")
multiplication_3 = Multiplication(A=remap_2.Mapped, B="5")
multiplication_4 = Multiplication(A=remap_3.Mapped, B="5")

Y = UnitY(Factor=multiplication_4)
Y_2 = UnitY(Factor=multiplication_3)
X = UnitX(Factor=multiplication_2)
X_2 = UnitX(Factor=multiplication)

move = Move(Geometry=bang.Branch1, Motion=X)  # -> Geometry, Transform
move_2 = Move(Geometry=bang.Branch2, Motion=X_2)  # -> Geometry, Transform
move_3 = Move(Geometry=bang.Branch5, Motion=X)  # -> Geometry, Transform
move_4 = Move(Geometry=bang.Branch6, Motion=X_2)  # -> Geometry, Transform
merge = Merge(Data1=bang.Branch0, Data2=move.Geometry, Data3=move_2.Geometry, Data4=bang.Branch3)
merge_2 = Merge(Data1=bang.Branch4, Data2=move_3.Geometry, Data3=move_4.Geometry, Data4=bang.Branch7)
move_5 = Move(Geometry=merge, Motion=Y_2)  # -> Geometry, Transform
move_6 = Move(Geometry=merge_2, Motion=Y)  # -> Geometry, Transform
trim = TrimTree(Tree=[move_5.Geometry, move_6.Geometry], Depth=1)
merge_3 = Merge(Data1=split.Negative, Data2=trim)
mirror = Mirror(Geometry=merge_3, Plane=simplify(yz))  # -> reverse(Geometry), Transform
cullpt = CullDuplicates(Points=[merge_3, mirror.Geometry], Tolerance=0.1, CullMode=2)  # -> simplify(Points), Indices, Valence
pline = PolyLine(Vertices=cullpt.Points, Closed=invert(False))  # -> flatten(Polyline)
item_3 = ListItem(List=pline, Index=0, Wrap=True)  # -> Item1, Item
explode = Explode(Curve=pline, Recursive=True)  # -> simplify(Segments), Vertices
data = Data(item_3.Item)
flip = FlipMatrix(Data=explode.Segments)
explode_2 = Explode(Curve=data, Recursive=True)  # -> simplify(Segments), Vertices
cull_i = CullIndex(List=explode_2.Vertices, Indices=-1, Wrap=True)
plfit = PlaneFit(Points=explode_2.Vertices)  # -> Plane, Deviation
del = DelaunayMesh(Points=cull_i, Plane=plfit.Plane)
c_script = CSharpScript(S=flip)  # -> out, M, msg; inputs S: list of Curve, u: Int32, closedU: Boolean, closedV: Boolean, triangulate: Boolean
# ---------- c_script: C# ----------
#region Usings
using System;
using System.Collections.Generic;
using Rhino;
using Rhino.Geometry;
#endregion

public class Script_Instance : GH_ScriptInstance
{
  // Try to extract polyline points. If it fails, return null.
  List<Point3d> GetPolylineVerts(Curve crv)
  {
    if (crv == null || !crv.IsValid) return null;

    Polyline pl;
    if (crv.TryGetPolyline(out pl))
    {
      var pts = new List<Point3d>(pl.Count);
      for (int i = 0; i < pl.Count; i++) pts.Add(pl[i]);
      return pts;
    }
    return null;
  }

  // Sample curve by normalized parameter t in [0..1] using arc length (more even spacing than parameter space).
  List<Point3d> SampleByLength(Curve crv, int uCount)
  {
    if (crv == null || !crv.IsValid) return null;
    if (uCount < 2) uCount = 2;

    double L = crv.GetLength();
    if (L <= RhinoMath.ZeroTolerance) return null;

    var pts = new List<Point3d>(uCount);

    for (int i = 0; i < uCount; i++)
    {
      double s = (double)i / (uCount - 1) * L;
      double t;
      if (!crv.LengthParameter(s, out t))
      {
        // fallback: normalized domain
        double tt = (double)i / (uCount - 1);
        pts.Add(crv.PointAtNormalizedLength(tt));
      }
      else
      {
        pts.Add(crv.PointAt(t));
      }
    }
    return pts;
  }

  // Build mesh loft: U = samples along section, V = section index
  Mesh BuildMeshLoft(List<List<Point3d>> grid, bool closedU, bool closedV, bool triangulate)
  {
    int vCount = grid.Count;
    int uCount = grid[0].Count;

    Mesh m = new Mesh();

    // Add vertices: (v,u) -> vertex index
    int[,] vid = new int[vCount, uCount];
    for (int v = 0; v < vCount; v++)
    {
      for (int u = 0; u < uCount; u++)
      {
        vid[v, u] = m.Vertices.Add(grid[v][u]);
      }
    }

    int uMax = closedU ? uCount : uCount - 1;
    int vMax = closedV ? vCount : vCount - 1;

    for (int v = 0; v < vMax; v++)
    {
      int vNext = (v + 1) % vCount;

      for (int u = 0; u < uMax; u++)
      {
        int uNext = (u + 1) % uCount;

        int a = vid[v,     u];
        int b = vid[v,     uNext];
        int c = vid[vNext, uNext];
        int d = vid[vNext, u];

        // If not closedU and we're at the last column, skip
        if (!closedU && u == uCount - 1) continue;
        // If not closedV and we're at the last row, skip
        if (!closedV && v == vCount - 1) continue;

        m.Faces.AddFace(a, b, c, d);
      }
    }

    if (triangulate)
      m.Faces.ConvertQuadsToTriangles();

    m.Normals.ComputeNormals();
    m.Compact();
    return m;
  }

  private void RunScript(
	List<Curve> S,
	int u,
	bool closedU,
	bool closedV,
	bool triangulate,
	ref object M,
	ref object msg)
  {
    msg = "";

    if (S == null || S.Count < 2)
    {
      M = null;
      msg = "Need at least 2 section curves.";
      return;
    }

    // Build per-section point lists
    var grid = new List<List<Point3d>>();
    int expectedU = -1;

    for (int i = 0; i < S.Count; i++)
    {
      Curve crv = S[i];
      if (crv == null || !crv.IsValid)
      {
        M = null;
        msg = $"Section {i} is null/invalid.";
        return;
      }

      List<Point3d> pts = null;

      if (u <= 0)
      {
        // Use polyline vertices mode
        pts = GetPolylineVerts(crv);
        if (pts == null)
        {
          M = null;
          msg = $"Section {i} is not a polyline. Set u > 0 to resample.";
          return;
        }

        // Many polylines are closed and repeat the first point at the end; remove duplicate end point.
        if (pts.Count >= 2 && pts[0].DistanceTo(pts[pts.Count - 1]) <= RhinoMath.ZeroTolerance)
          pts.RemoveAt(pts.Count - 1);
      }
      else
      {
        // Resample by arc length to u points
        pts = SampleByLength(crv, u);
        if (pts == null)
        {
          M = null;
          msg = $"Failed sampling section {i}.";
          return;
        }
      }

      if (pts.Count < 2)
      {
        M = null;
        msg = $"Section {i} has < 2 points after sampling.";
        return;
      }

      if (expectedU < 0) expectedU = pts.Count;
      if (pts.Count != expectedU)
      {
        M = null;
        msg = $"Point count mismatch at section {i}: got {pts.Count}, expected {expectedU}.";
        return;
      }

      grid.Add(pts);
    }

    // Build mesh
    Mesh mesh = BuildMeshLoft(grid, closedU, closedV, triangulate);
    if (mesh == null || mesh.Vertices.Count == 0)
    {
      M = null;
      msg = "Mesh build failed.";
      return;
    }

    msg = $"OK: sections={grid.Count}, U={grid[0].Count}, verts={mesh.Vertices.Count}, faces={mesh.Faces.Count}";
    M = mesh;
  }
}
# ---------- end c_script ----------
mesh = Mesh(c_script.M)
mjoin = MeshJoin(Meshes=flatten([mesh, del]))
area = Area(Geometry=mjoin)  # -> Area, Centroid
yz_2 = YZPlane(Origin=area.Centroid)
subtraction = Subtraction(A=pt_2, B=area.Centroid)
addition = Addition(A=subtraction, B=Z)
move_7 = Move(Geometry=mjoin, Motion=addition)  # -> Geometry, Transform
demesh = DeconstructMesh(Mesh=move_7.Geometry)  # -> Vertices, Faces, Colours, Normals
rotate = Rotate(Geometry=mjoin, Angle=pi, Plane=yz_2)  # -> Geometry, Transform; disabled
mcol = MeshColours(Mesh=move_7.Geometry, Colours=demesh.Normals)
flip_2 = MeshFlip(Mesh=mcol)
flip_3 = MeshFlip(Mesh=mcol)
mjoin_2 = MeshJoin(Meshes=[mcol, flip_3])  # disabled
c_script_2 = CSharpScript(mesh=mjoin_2)  # -> base64Draco; inputs mesh: Mesh; disabled
# ---------- c_script_2: C# ----------
    var options = new Rhino.FileIO.DracoCompressionOptions();
    options.CompressionLevel = 5;
    options.IncludeTextureCoordinates = false;
    options.IncludeVertexColors = true;

    var compressed = Rhino.FileIO.DracoCompression.Compress(mesh, options);
    base64Draco = compressed.ToBase64String();
# ---------- end c_script_2 ----------
rh_out_mesh_m = Mesh([mcol, flip_3])
context_print = ContextPrint(MeshB64=c_script_2)
